# Grasshopper definition debug_aux.gh (Grasshopper 0.9.76)
# plug-ins: SunTools

number_slider = Slider(0.75, range=0..3)
dom = ConstructDomain(DomainStart=Slider(-2, range=-2..10), DomainEnd=Slider(2, range=-2..10))
sqrt = SquareRoot(Value=number_slider)
num = Number(number_slider)
pt = ConstructPoint(XCoordinate=Slider(-1.3426, range=-2..10), YCoordinate="0", ZCoordinate=0)
dom_2 = ConstructDomain(DomainStart=expr("-x", num), DomainEnd=num)
rectangle = Rectangle(Plane=PlaneXY(0, 0, 0), XSize=dom, YSize=dom, Radius=0)  # -> Rectangle, Length
xy = XYPlane(Origin=pt)
rad = Radians(Degrees=Slider(45, range=0..100))
rectangle_2 = Rectangle(Plane=xy, XSize=dom_2, YSize=dom_2, Radius=0)  # -> Rectangle, Length
cir = Circle(Plane=xy, Radius=number_slider)
rotate = Rotate(Geometry=rectangle_2.Rectangle, Angle=rad, Plane=xy)  # -> Geometry, Transform
crv = Curve(cir)
crv_2 = Curve(rectangle.Rectangle)
xy_2 = XYPlane(Origin=Point(0, 0, 0))
item = ListItem(List=crv, Index=Slider(0, range=0..1), Wrap=True)
runion = RegionUnion(Curves=crv, Plane=xy_2)
rdiff = RegionDifference(CurvesA=crv_2, CurvesB=crv)
mesh = MeshBrep(
    Brep=crv,
    Settings={GridMaxCount=0, GridMinCount=16, JaggedSeams=False, MaxEdgeLength=0, MinEdgeLength=0.0001, MinTolerance=0, Refine=True, RefineAngle=0, RelativeTolerance=0.65, SimplePlanes=True, Tolerance=0})  # disabled
mesh_2 = MeshBrep(
    Brep=crv_2,
    Settings={GridMaxCount=0, GridMinCount=16, JaggedSeams=False, MaxEdgeLength=0, MinEdgeLength=0.0001, MinTolerance=0, Refine=True, RefineAngle=0, RelativeTolerance=0.65, SimplePlanes=True, Tolerance=0})  # disabled
rinter = RegionInter(CurvesA=crv, CurveB=crv_2, Plane=xy_2)  # -> ResultingIntersection, AreaOfResultingRegion, CommentOnIntersectionType
regiondiff = BooleanDifferenceOfCoPlanarCurves(Curve1=crv_2, Curve2=crv, Plane=xy_2)  # -> DifferenceRegionC1MinusC2, AreaOfResultingRegion, CommentOnDifferenceType
mdif = MeshDifference(MeshesA=mesh, MeshesB=mesh_2)  # disabled
crv_3 = Curve(rinter.ResultingIntersection)
item_2 = ListItem(List=regiondiff.DifferenceRegionC1MinusC2, Index=Slider(1, range=0..1), Wrap=True)
preview = CustomPreview(Geometry=regiondiff.DifferenceRegionC1MinusC2, Shader=ColourSwatch(SwatchColor=RGB(255, 0, 179)))
boundary = BoundarySurfaces(Edges=[crv, crv_2])  # disabled
panel = Panel(regiondiff.CommentOnDifferenceType)
panel_2 = Panel(regiondiff.AreaOfResultingRegion)
edges = BrepEdges(Brep=boundary)  # -> Naked, Interior, NonManifold; disabled
crv_4 = Curve(edges.Naked)  # disabled
