# Grasshopper definition debug_glareAssess.gh (Grasshopper 0.9.76)
# plug-ins: SunTools

panel = Panel("""-0.30
0.20""")
panel_2 = Panel("""1
-1.3""")
pt = ConstructPoint(XCoordinate=panel, YCoordinate=0, ZCoordinate=panel_2)
pt_2 = ConstructPoint(XCoordinate="3", YCoordinate="3", ZCoordinate=0)
dom = ConstructDomain(DomainStart=Slider(6.4, range=-10..10), DomainEnd=Slider(-2.4, range=-10..10))
dom_2 = ConstructDomain(DomainStart=Slider(-4, range=-10..10), DomainEnd=Slider(5.2, range=-10..10))
yz = YZPlane(Origin=pt_2)
xz = XZPlane(Origin=pt)
dom_3 = ConstructDomain(DomainStart=Slider(-2.3, range=-10..10), DomainEnd=Slider(2.2, range=-10..10))
rectangle = Rectangle(Plane=yz, XSize=dom, YSize=dom_2, Radius=0)  # -> Rectangle, Length
xz_2 = XZPlane(Origin=Point(0, 0, 0))
cir = Circle(Plane=xz, Radius=Slider(0.47, range=0..1))
rectangle_2 = Rectangle(Plane=xz_2, XSize=dom_3, YSize=dom_3, Radius=0)  # -> Rectangle, Length
boundary = BoundarySurfaces(Edges=rectangle.Rectangle)
crv = Curve(rectangle_2.Rectangle)
vec = VectorXYZ(XComponent=Slider(6.2, range=-10..10), YComponent=Slider(10, range=-10..10), ZComponent=Slider(0, range=-10..10))  # -> Vector, Length
boundary_2 = BoundarySurfaces(Edges=crv)
unit = UnitVector(Vector=vec.Vector)
mesh = MeshBrep(
    Brep=boundary,
    Settings={GridMaxCount=0, GridMinCount=16, JaggedSeams=False, MaxEdgeLength=0, MinEdgeLength=0.0001, MinTolerance=0, Refine=True, RefineAngle=0, RelativeTolerance=0.65, SimplePlanes=True, Tolerance=0})
mesh_2 = MeshBrep(
    Brep=boundary_2,
    Settings={GridMaxCount=0, GridMinCount=16, JaggedSeams=False, MaxEdgeLength=0, MinEdgeLength=0.0001, MinTolerance=0, Refine=True, RefineAngle=0, RelativeTolerance=0.65, SimplePlanes=True, Tolerance=0})
vdis = VectorDisplay(Anchor=pt, Vector=unit)
facen = FaceNormals(Mesh=mesh_2)  # -> Centers, Normals
item = ListItem(List=facen.Normals, Index=0, Wrap=True)
item_2 = ListItem(List=facen.Centers, Index=0, Wrap=True)
glareassess = GlareOnWallPanel(WallPanel=mesh, SourceOutline=mesh_2, ProjectionDirectionVector=unit, LaunchTheAnalysis=Toggle(True))  # -> OutlineOfGlare, AreaOfExposed, CommentOnOperationType, ProjectedMeshOfGlareForDebugging
vdis_2 = VectorDisplay(Anchor=item_2, Vector=item)
projecta = ProjectAlong(Geometry=mesh_2, Plane=yz, Direction=unit)  # -> Geometry, Transform
facen_2 = FaceNormals(Mesh=projecta.Geometry)  # -> Centers, Normals
item_3 = ListItem(List=facen_2.Normals, Index=0, Wrap=True)
item_4 = ListItem(List=facen_2.Centers, Index=0, Wrap=True)
mesh_3 = Mesh(glareassess.OutlineOfGlare)
medges = MeshEdges(Mesh=mesh_3)  # -> NakedEdges, InteriorEdges, NonManifoldEdges
panel_3 = Panel(glareassess.AreaOfExposed)
panel_4 = Panel(glareassess.CommentOnOperationType)
crv_2 = Curve(glareassess.ProjectedMeshOfGlareForDebugging)
vdis_3 = VectorDisplay(Anchor=item_4, Vector=item_3)
facen_3 = FaceNormals(Mesh=mesh_3)  # -> Centers, Normals
preview = CustomPreview(
    Geometry=mesh_3,
    Shader={ambient=RGB(0, 0, 0), diffuse=RGB(255, 105, 180), emission=RGB(76, 32, 54), shine=0.5, specular=RGB(255, 255, 255), transparency=0})
item_5 = ListItem(List=facen_3.Normals, Index=0, Wrap=True)
item_6 = ListItem(List=facen_3.Centers, Index=0, Wrap=True)
vdis_4 = VectorDisplay(Anchor=item_6, Vector=item_5)
