# Grasshopper definition debug_shadeAssess.gh (Grasshopper 0.9.76)
# plug-ins: SunTools

yz = YZPlane(Origin=Point(0, 0, 0))
dom = ConstructDomain(DomainStart=Slider(-10, range=-10..10), DomainEnd=Slider(10, range=-10..10))
dom_2 = ConstructDomain(DomainStart=Slider(-10, range=-10..10), DomainEnd=Slider(10, range=-10..10))
rectangle = Rectangle(Plane=yz, XSize=dom, YSize=dom_2, Radius=0)  # -> Rectangle, Length
pt = ConstructPoint(XCoordinate=Slider(-5, range=-10..10), YCoordinate=Slider(0, range=-10..10), ZCoordinate=Slider(5.25, range=-10..10))
vec = VectorXYZ(XComponent=Slider(5, range=-10..10), YComponent=Slider(-2.86, range=-10..10), ZComponent=Slider(-5, range=-10..10))  # -> Vector, Length
boundary = BoundarySurfaces(Edges=rectangle.Rectangle)
unit = UnitVector(Vector=vec.Vector)
mesh = MeshBrep(
    Brep=boundary,
    Settings={GridMaxCount=0, GridMinCount=16, JaggedSeams=False, MaxEdgeLength=0, MinEdgeLength=0.0001, MinTolerance=0, Refine=True, RefineAngle=0, RelativeTolerance=0.65, SimplePlanes=True, Tolerance=0})
vdis = VectorDisplay(Anchor=pt, Vector=unit)
pl = PlaneNormal(Origin=pt, ZAxis=unit)
vec_2 = VectorXYZ(XComponent=Slider(3.69, range=-10..10), YComponent=Slider(-0.41, range=-10..10), ZComponent=Slider(-4.47, range=-10..10))  # -> Vector, Length
deplane = DeconstructPlane(Plane=pl)  # -> Origin, XAxis, YAxis, ZAxis
rectangle_2 = Rectangle(Plane=pl, XSize=Domain(-1, 1), YSize=Domain(-2, 2), Radius=0)  # -> Rectangle, Length
multiplication = Multiplication(A=deplane.XAxis, B="-3")
multiplication_2 = Multiplication(A=deplane.YAxis, B="5")
vdis_2 = VectorDisplay(Anchor=pt, Vector=vec_2.Vector)
boundary_2 = BoundarySurfaces(Edges=rectangle_2.Rectangle)
mesh_2 = MeshBrep(
    Brep=boundary_2,
    Settings={GridMaxCount=0, GridMinCount=16, JaggedSeams=False, MaxEdgeLength=0, MinEdgeLength=0.0001, MinTolerance=0, Refine=True, RefineAngle=0, RelativeTolerance=0.65, SimplePlanes=True, Tolerance=0})
move = Move(Geometry=mesh_2, Motion=multiplication)  # -> Geometry, Transform
move_2 = Move(Geometry=move.Geometry, Motion=multiplication_2)  # -> Geometry, Transform
mjoin = MeshJoin(Meshes=[mesh_2, move.Geometry, move_2.Geometry])
mesh_3 = Mesh(mjoin)
preview = CustomPreview(Geometry=mesh_3, Shader=ColourSwatch(SwatchColor=RGBA(71, 160, 255, 113)))
shadeassess = ShadeOnFaçadePanel(FaçadePanel=mesh, ShadeSurface=mesh_3, ProjectionDirectionVector=vec_2.Vector, LaunchTheAnalysis=Toggle(True))  # -> OutlineOfShade, AreaOfExposed, CommentOnOperationType, DebugMeshcutter
panel = Panel("""0
1
3""")
panel_2 = Panel(shadeassess.CommentOnOperationType)
mesh_4 = Mesh(shadeassess.DebugMeshcutter)
panel_3 = Panel(shadeassess.OutlineOfShade)
mesh_5 = Mesh(shadeassess.OutlineOfShade)
item = ListItem(List=mesh_5, Index=panel, Wrap=True)
preview_2 = CustomPreview(
    Geometry=item,
    Shader={ambient=RGB(0, 0, 0), diffuse=RGB(255, 105, 180), emission=RGB(76, 32, 54), shine=0.5, specular=RGB(255, 255, 255), transparency=0})
