# Grasshopper definition room_simpleShade_optimization.gh (Grasshopper 0.9.76)
# plug-ins: Human, IvyGh, SunTools

number_slider = Slider(4, range=0..10)
number_slider_2 = Slider(2.2, range=0..10)
division = Division(A=number_slider_2, B=-2)
division_2 = Division(A=number_slider_2, B=2)
division_3 = Division(A=number_slider, B=-2)
division_4 = Division(A=number_slider, B=2)
pi = Pi(Factor=2)
rad = Radians(Degrees=Slider(105, range=90..270))
yz = YZPlane(Origin=Point(0, 0, 0))
subtraction = Subtraction(A=pi, B=rad)
dom = ConstructDomain(DomainStart=division, DomainEnd=division_2)
dom_2 = ConstructDomain(DomainStart=division_3, DomainEnd=division_4)
rotate = Rotate(Geometry=yz, Angle=subtraction, Plane=PlaneXY(0, 0, 0))  # -> Geometry, Transform
number_slider_3 = Slider(1, range=0..1)
rectangle = Rectangle(Plane=rotate.Geometry, XSize=dom_2, YSize=dom, Radius=0)  # -> Rectangle, Length
mplane = MeshPlane(Boundary=rectangle.Rectangle, WidthCount=number_slider_3, HeightCount=number_slider_3)  # -> Mesh, Area
facen = FaceNormals(Mesh=mplane.Mesh)  # -> Centers, Normals

# ---- group: ROOM
number_slider_4 = Slider(0.5, range=0..1)
normal_window = Vector(facen.Normals)
mesh = Mesh(mplane.Mesh)
medges = MeshEdges(Mesh=mesh)  # -> NakedEdges, InteriorEdges, NonManifoldEdges
unit = UnitVector(Vector=normal_window)
multiplication = Multiplication(A=number_slider_4, B=-1)
# Room geometry
item = ListItem(List=medges.NakedEdges, Index="1", Wrap=True)
multiplication_2 = Multiplication(A=unit, B=Slider(0, range=-1..0))
Z = UnitZ(Factor=multiplication)
multiplication_3 = Multiplication(A=unit, B=Slider(-5, range=-10..-1))
addition = Addition(A=multiplication_2, B=Z)
move = Move(Geometry=item, Motion=addition)  # -> Geometry, Transform
multiplication_4 = Multiplication(A=number_slider_4, B=2)
end = EndPoints(Curve=move.Geometry)  # -> Start, End
addition_2 = Addition(A=number_slider_2, B=multiplication_4)
move_2 = Move(Geometry=end.Start, Motion=multiplication_3)  # -> Geometry, Transform
move_3 = Move(Geometry=end.End, Motion=multiplication_3)  # -> Geometry, Transform
Z_2 = UnitZ(Factor=addition_2)
pt = Point(end.Start)
move_4 = Move(Geometry=pt, Motion=Z_2)  # -> Geometry, Transform
pt_2 = Point(move_2.Geometry)
move_5 = Move(Geometry=pt_2, Motion=Z_2)  # -> Geometry, Transform
pt_3 = Point(end.End)
move_6 = Move(Geometry=pt_3, Motion=Z_2)  # -> Geometry, Transform
pt_4 = Point(move_3.Geometry)
move_7 = Move(Geometry=pt_4, Motion=Z_2)  # -> Geometry, Transform
c_script = CSharpScript(A=pt, B=pt_2, C=pt_4, D=pt_3)  # -> out, mesh, edges, plane; inputs A: Point3d, B: Point3d, C: Point3d, D: Point3d
# ---------- c_script: C# ----------
    var p1 = (Point3d) A;
    var p2 = (Point3d) B;
    var p3 = (Point3d) C;
    var p4 = (Point3d) D;
    List < Point3d > vert = new List<Point3d>(){p1,p2,p3,p4};

    var f1 = new Rhino.Geometry.MeshFace(0, 1, 2, 3);
    var m1 = new Rhino.Geometry.Mesh();
    var pl1 = new Rhino.Geometry.Plane(p1, p2, p4);

    m1.Vertices.AddVertices(vert);
    m1.Faces.AddFace(f1);

    var e1 = new List<Polyline>(m1.GetNakedEdges());

    mesh = m1;
    plane = pl1;
    edges = e1;
# ---------- end c_script ----------
c_script_2 = CSharpScript(A=pt, B=pt_2, C=move_5.Geometry, D=move_4.Geometry)  # -> out, mesh, edges, plane; inputs A: Point3d, B: Point3d, C: Point3d, D: Point3d; same code as c_script
c_script_3 = CSharpScript(A=pt_2, B=pt_4, C=move_7.Geometry, D=move_5.Geometry)  # -> out, mesh, edges, plane; inputs A: Point3d, B: Point3d, C: Point3d, D: Point3d; same code as c_script
c_script_4 = CSharpScript(A=pt_3, B=pt_4, C=move_7.Geometry, D=move_6.Geometry)  # -> out, mesh, edges, plane; inputs A: Point3d, B: Point3d, C: Point3d, D: Point3d; same code as c_script
mjoin = MeshJoin(Meshes=[c_script.mesh, c_script_2.mesh, c_script_3.mesh, c_script_4.mesh])

# ----
# Shade geometry
dom_3 = ConstructDomain(DomainStart=Slider(0, range=0..90), DomainEnd=Slider(70, range=0..90))
dom_4 = ConstructDomain(DomainStart=Slider(0, range=0..1), DomainEnd=Slider(1, range=0..1))
panel = Panel("""agl
ext""")
random = Random(Range=dom_3, Number=Slider(10, range=0..10), Seed=2)
random_2 = Random(Range=dom_4, Number=Slider(4, range=0..10), Seed=2)
txt = Text(panel)
entwine = Entwine(Branch00=random, Branch01=random_2, FlattenInputs=True)
grid = ConstructGrid(InputRange=entwine, Labels=txt)  # -> GridInformations, Grid
medges_2 = MeshEdges(Mesh=mplane.Mesh)  # -> NakedEdges, InteriorEdges, NonManifoldEdges
c_script_5 = CSharpScript(
    input_grid=grid.Grid,
    hwindow=number_slider_2,
    N=facen.Normals,
    Reference="C:\Users\admin\AppData\Roaming\Grasshopper\Libraries\IvyCore.dll")  # -> out, V; inputs hwindow: Double, N: Vector3d
# ---------- c_script_5: C# ----------
    var normal = (Vector3d) N;
    var hwin = (double) hwindow;
    var gact = (IvyCore.MultiDimGrid.Grid) input_grid;


    var nn = gact.NodeCount;
    var vec = new List<Vector3d>();
    //var actuationstate = new double[nn][];
    var origin = new Point3d(0.0, 0.0, 0.0);
    var rotaxis = Vector3d.CrossProduct(normal, new Vector3d(0.0, 0.0, -1.0));

    for (int i = 0;i < nn;i++)
    {
      var ag = -Math.PI * gact.Nodes[i][0] / 180;
      var ext = gact.Nodes[i][1];

      var current_vec = new Vector3d(0.0, 0.0, -1.0);

      current_vec.Transform(Transform.Rotation(ag, rotaxis, origin));
      current_vec = ext * (hwin) * current_vec;
      vec.Add(current_vec);

    }

    V = vec;
# ---------- end c_script_5 ----------
item_2 = ListItem(List=medges_2.NakedEdges, Index=Slider(2, range=0..10), Wrap=True)
extr = Extrude(Base=item_2, Direction=c_script_5.V)
panel_2 = Panel(grid.GridInformations)
mesh_2 = MeshBrep(
    Brep=extr,
    Settings={GridMaxCount=0, GridMinCount=16, JaggedSeams=False, MaxEdgeLength=0, MinEdgeLength=0.0001, MinTolerance=0, Refine=True, RefineAngle=0, RelativeTolerance=0.65, SimplePlanes=True, Tolerance=0})

# ----
# Sun Vectors
X = UnitX(Factor=1)
azi = Number([126.3264092, 137.3313031, 149.9081719, 164.0725822, 179.3051332, 194.5902344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])
ele = Number([5.239618324, 13.76930373, 20.56615289, 25.05155863, 26.71385892, 25.32899458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])
num = Number([8, 9, 10, 11, 12, 13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])
sunsifting = SiftSunOrientations(North=X, SunAzimuth=azi, SunAltitude=ele, AssociatedSunHours=num, FaçadePanelToEvaluate=mplane.Mesh)  # -> ResultingSiftedSunAzimuthAngles, ResultingSiftedSunAltitudeAngles, ResultingSiftedHours, ResultingSuftedSunVectors
item_3 = ListItem(List=sunsifting.ResultingSuftedSunVectors, Index=Slider(1716, range=0..3578), Wrap=True)  # -> simplify(Item)

digit_scroller = DigitScroller(Scroller_Digits=12, Scroller_Radix=9, Scroller_Value=476)
digit_scroller_2 = DigitScroller(Scroller_Digits=12, Scroller_Radix=9, Scroller_Value=3469)
number_slider_5 = Slider(1533, range=0..3578)
# Window geometry
number_slider_6 = Slider(880, range=0..3578)
c_script_6 = CSharpScript()  # -> out, A; inputs x: list of Double; disabled
# ---------- c_script_6: C# ----------
    var inList = (List<double>) x;
    string outString = null;

    for (int i = 0;i < inList.Count;i++)
    {
      if (i< inList.Count - 1)
      {
        outString += x[i].ToString() + ",";
      }
      else
      {
         outString += x[i].ToString();
      }
    }

    A = outString;
# ---------- end c_script_6 ----------
series = Series(Start=number_slider_6, Step=1, Count=Slider(1, range=1..3000))
item_4 = ListItem(List=sunsifting.ResultingSiftedHours, Index=series, Wrap=True)  # -> simplify(Item)
num_2 = Number(item_4)
vec = Vector(item_3)
panel_3 = Panel(item_4)
vdis = VectorDisplay(Anchor=facen.Centers, Vector=vec)
number_slider_7 = Slider(10, range=0..100)
item_5 = ListItem(List=mesh_2, Index=Slider(93, range=0..100), Wrap=True)
mesh_3 = Mesh(item_5)

# ----
# Seasonal coeficient
c_script_7 = CSharpScript(
    SD_sum=Slider(1, range=0..10),
    VW_sum=Slider(2, range=0..10),
    GL_sum=Slider(1, range=0..10),
    SD_win=Slider(1, range=0..10),
    VW_win=Slider(3, range=0..10),
    GL_win=Slider(1, range=0..10))  # -> out, winterCoef, summerCoef; inputs SD_sum: Double, VW_sum: Double, GL_sum: Double, SD_win: Double, VW_win: Double, GL_win: Double
# ---------- c_script_7: C# ----------
    var shade_sum = (double) SD_sum;
    var view_sum = (double) VW_sum;
    var glare_sum = (double) GL_sum;
    var shade_win = (double) SD_win;
    var view_win = (double) VW_win;
    var glare_win = (double) GL_win;

    double sum_summer = shade_sum + view_sum + glare_sum;
    double sum_winter = shade_win + view_win + glare_win;

    shade_sum = shade_sum / sum_summer;
    view_sum = view_sum / sum_summer;
    glare_sum = glare_sum / sum_summer;

    shade_win = shade_win / sum_winter;
    view_win = view_win / sum_winter;
    glare_win = glare_win / sum_winter;


    string sumC = shade_sum.ToString() + ",-" + view_sum.ToString() + "," + glare_sum.ToString();
    string winC = "-" + shade_win.ToString() + ",-" + view_win.ToString() + "," + glare_win.ToString();

    winterCoef = winC;
    summerCoef = sumC;
# ---------- end c_script_7 ----------
panel_4 = Panel(c_script_7.winterCoef)
panel_5 = Panel(c_script_7.summerCoef)
winter_period_start = Panel("8472")
winter_period_end = Panel("1872")
seasoncoef = SeasonalParsingAndWeighing(
    SunHours=num_2,
    StartOfWinterPeriod=winter_period_start,
    EndOfWinterPeriod=winter_period_end,
    WinterWeightString=panel_4,
    SummerWeightString=panel_5)

multiplication_5 = Multiplication(A=vec, B=-1)
deplane = DeconstructPlane(Plane=c_script_4.plane)  # -> Origin, XAxis, YAxis, ZAxis
extr_2 = Extrude(Base=c_script_4.edges, Direction=deplane.ZAxis)
multiplication_6 = Multiplication(A=deplane.ZAxis, B=Slider(-0.5, range=-0.5..0))
move_8 = Move(Geometry=extr_2, Motion=multiplication_6)  # -> Geometry, Transform
panel_6 = Panel(num_2)
mesh_4 = MeshBrep(
    Brep=move_8.Geometry,
    Settings={GridMaxCount=0, GridMinCount=16, JaggedSeams=False, MaxEdgeLength=0, MinEdgeLength=0.0001, MinTolerance=0, Refine=True, RefineAngle=0, RelativeTolerance=0.65, SimplePlanes=True, Tolerance=0})
number_slider_8 = Slider(0, range=0..10)
panel_7 = Panel("admin")  # disabled
panel_8 = Panel("Victor")  # disabled
panel_9 = Panel("C:\Users\")  # disabled
panel_10 = Panel("\Desktop\data_fitv2\")  # disabled
concat = Concatenate(FragmentA=panel_9, FragmentB=panel_7)  # disabled
concat_2 = Concatenate(FragmentA=concat, FragmentB=panel_10)  # disabled
panel_11 = Panel(concat_2)  # disabled

# ----
# Create Matlab analysis files
number_slider_9 = Slider(0, range=0..20)  # disabled
number_slider_10 = Slider(1, range=0..20)  # disabled
path = FilePath(panel_11)  # disabled
grid_2 = Grid(grid.Grid)  # disabled
c_script_8 = CSharpScript(
    seasonCoefs=seasoncoef,
    normalizationMin=number_slider_9,
    normalizationMax=number_slider_10,
    act=grid_2,
    workdir=path,
    Reference="C:\USERS\ADMIN\APPDATA\ROAMING\GRASSHOPPER\LIBRARIES\IvyCore.dll")  # -> out; inputs Shade: tree of Double, View: tree of Double, Glare: tree of Double, seasonCoefs: list of String, normalizationMin: Double, normalizationMax: Double, workdir: String; disabled
# ---------- c_script_8: C# ----------
    var tree_output1 = (DataTree<double>) Shade;
    var tree_output2 = (DataTree<double>) View;
    var tree_output3 = (DataTree<double>) Glare;
    var list_output1 = (List<string>) seasonCoefs;
    var minNorm = (double) normalizationMin;
    var maxNorm = (double) normalizationMax;
    var workingDir = (string) workdir;
    var gact = (IvyCore.MultiDimGrid.Grid) act;




    int nb = tree_output1.BranchCount;

    var filePath1 = workingDir + "\\gh-" + "shade" + ".csv";
    var filePath2 = workingDir + "\\gh-" + "view" + ".csv";
    var filePath3 = workingDir + "\\gh-" + "glare" + ".csv";
    var filePath4 = workingDir + "\\gh-" + "actuation" + ".csv";
    var filePath5 = workingDir + "\\gh-" + "seasonalCoefficients" + ".csv";

    System.Text.StringBuilder csv1 = new System.Text.StringBuilder();
    System.Text.StringBuilder csv2 = new System.Text.StringBuilder();
    System.Text.StringBuilder csv3 = new System.Text.StringBuilder();
    System.Text.StringBuilder csv4 = new System.Text.StringBuilder();
    System.Text.StringBuilder csv5 = new System.Text.StringBuilder();


    //Normalization of trees
    NormalizeDatatree(tree_output1, minNorm, maxNorm);
    NormalizeDatatree(tree_output2, minNorm, maxNorm);
    NormalizeDatatree(tree_output3, minNorm, maxNorm);


    //write actuation file

    for (int j = 0;j < gact.NodeCount;j++)
    {
      var newline = string.Format("{0},{1}", gact.Nodes[j][0].ToString(), gact.Nodes[j][1].ToString());
      csv4.AppendLine(newline);
    }
    System.IO.File.WriteAllText(filePath4, csv4.ToString());

    //write actuation file

    for (int j = 0;j < list_output1.Count;j++)
    {
      var newline = string.Format("{0}", list_output1[j]);
      csv5.AppendLine(newline);
    }
    System.IO.File.WriteAllText(filePath5, csv5.ToString());


    //write shade, view & glare csv files
    for (int i = 0;i < nb;i++)
    {

      //populate shade files
      string newline1 = "";
      for (int j = 0;j < tree_output1.Branch(i).Count;j++)
      {
        if (j + 1 < tree_output1.Branch(i).Count)
        {
          newline1 += tree_output1.Branch(i)[j].ToString() + ",";
        }
        else
        {
          newline1 += tree_output1.Branch(i)[j].ToString();
        }
      }
      csv1.AppendLine(newline1);

      //populate view files
      string newline2 = "";
      for (int j = 0;j < tree_output1.Branch(i).Count;j++)
      {
        if (j + 1 < tree_output1.Branch(i).Count)
        {
          newline2 += tree_output2.Branch(i)[0].ToString() + ",";
        }
        else
        {
          newline2 += tree_output2.Branch(i)[0].ToString();
        }
      }
      csv2.AppendLine(newline2);

      //populate glare files
      string newline3 = "";
      for (int j = 0;j < tree_output3.Branch(i).Count;j++)
      {
        if (j + 1 < tree_output3.Branch(i).Count)
        {
          newline3 += tree_output3.Branch(i)[j].ToString() + ",";
        }
        else
        {
          newline3 += tree_output3.Branch(i)[j].ToString();
        }
      }
      csv3.AppendLine(newline3);

    }

    System.IO.File.WriteAllText(filePath1, csv1.ToString());
    System.IO.File.WriteAllText(filePath2, csv2.ToString());
    System.IO.File.WriteAllText(filePath3, csv3.ToString());


    //GH OUTPUT COMMENTS
    Print("OUTPUT DIR : " + workingDir);
    Print("PROCESS EXIT");
# ---------- c_script_8: C# additional code ----------
  private static DataTree<double> NormalizeDatatree(DataTree < double > tree, double min, double max)
  {
    double treemax = tree.AllData().Max();
    double treemin = tree.AllData().Min();
    double range = treemax - treemin;

    for (int i = 0;i < tree.BranchCount;i++)
    {
      var currentBrancha = new double[tree.Branch(i).Count];
      tree.Branch(i).CopyTo(currentBrancha);
      tree.Branch(i).Clear();
      tree.Branch(i).AddRange(NormalizeList(ArrayToList(currentBrancha), treemin, treemax, min, max));
    }

    return tree;
  }


  private static List<double> NormalizeList(List<double> data, double glmin, double glmax, double min, double max)
  {
    double dataMax = glmax;
    double dataMin = glmin;
    double range = dataMax - dataMin;

    return data
      .Select(d => (d - dataMin) / range)
      .Select(n => (double) ((1 - n) * min + n * max))
      .ToList();
  }

  private static List<double> ArrayToList(double[] data)
  {
    List<double> datalist = new List<double>(data.Length);
    for (int i = 0;i < data.Length;i++)
    {
      datalist.Add(data[i]);
    }
    return datalist;
  }
# ---------- end c_script_8 ----------
panel_12 = Panel(c_script_8)  # disabled

panel_13 = Panel("outMatlab.csv")  # disabled
workingdir = FilePath(path)  # disabled
timer = Timer(TimerInterval=10000, Target=concat_3)  # disabled
concat_3 = Concatenate(FragmentA=workingdir, FragmentB=panel_13)  # disabled
# Visualize data
panel_14 = Panel(concat_3)  # disabled
c_script_9 = CSharpScript(x=concat_3)  # -> out, A, B; inputs x: String; disabled
# ---------- c_script_9: C# ----------
    var filePath = (string) x;
    var reader = new StreamReader(filePath);

    List<string> listA = new List<string>();
    List<string> listB = new List<string>();

    while (!reader.EndOfStream)
    {
      var line = reader.ReadLine();
      var values = line.Split(',');

      listA.Add(values[0]);
      listB.Add(values[1]);
    }

    A = listA;
    B = listB;
# ---------- end c_script_9 ----------
num_3 = Number([4.8784e-06, 1.0894e-05, 4.5657e-05, 3.5625, 7.2872, 5.2224])  # disabled
num_4 = Number([1, 1, 1, 1, 1, 1])  # disabled
window_height = Number(number_slider_2)  # disabled
crv = Curve(item_2)  # disabled
window_normal = Vector(facen.Normals)  # disabled
extension_of_rolling_shade = Panel(c_script_9.B)  # disabled
angle_of_shade = Panel(c_script_9.A)  # disabled
top_rolling_shade = CSharpScript(
    act1=c_script_9.A,
    act2=c_script_9.B,
    hwindow=window_height,
    N=window_normal,
    tedge=crv,
    Reference="C:\USERS\ADMIN\APPDATA\ROAMING\GRASSHOPPER\LIBRARIES\IvyCore.dll")  # -> out, V, S; inputs act1: list of Double, act2: list of Double, hwindow: Double, N: Vector3d, tedge: Curve; disabled
# ---------- top_rolling_shade: C# ----------
    var normal = (Vector3d) N;
    var hwin = (double) hwindow;
    var Act1 = (List<double>) act1;
    var Act2 = (List<double>) act2;
    var top = (Curve) tedge;

    var surf = new List<GH_Surface>();

    var nn = Act1.Count;
    var vec = new List<Vector3d>();
    var origin = new Point3d(0.0, 0.0, 0.0);
    var rotaxis = Vector3d.CrossProduct(normal, new Vector3d(0.0, 0.0, -1.0));

    for (int i = 0;i < nn;i++)
    {
      var ag = -Math.PI * Act1[i] / 180;
      var ext = Act2[i];

      var current_vec = new Vector3d(0.0, 0.0, -1.0);

      current_vec.Transform(Transform.Rotation(ag, rotaxis, origin));
      current_vec = ext * (hwin) * current_vec;

      var current_surf = Rhino.Geometry.Extrusion.CreateExtrusion(top, current_vec);

      vec.Add(current_vec);
      surf.Add(new Grasshopper.Kernel.Types.GH_Surface(current_surf));

    }

    V = vec;
    S = surf;
# ---------- end top_rolling_shade ----------
srf = Surface(top_rolling_shade.S)  # disabled

matlab_exe_sp4 = FilePath("C:\Program Files\MATLAB\R2016b\bin\matlab.exe")  # disabled

panel_15 = Panel("optimization.m")  # disabled
matlab_exe_work = FilePath("C:\Program Files\MATLAB\R2016a\bin\matlab.exe")  # disabled
# Launch Matlab analysis
workingdir_2 = FilePath(path)  # disabled
concat_4 = Concatenate(FragmentA=workingdir_2, FragmentB=panel_15)  # disabled
lanch = Button()  # disabled
panel_16 = Panel(workingdir_2)  # disabled
c_script_10 = CSharpScript(path_to_m=concat_4, path_to_exe=matlab_exe_sp4, launch=lanch)  # -> out, A; inputs path_to_exe: String, launch: Boolean; disabled
# ---------- c_script_10: C# ----------
    string pathtoexe = (string) path_to_exe;
    string pathtofile = (string) path_to_m;

    string dir = System.IO.Path.GetDirectoryName(path_to_m.ToString());
    string filename = System.IO.Path.GetFileName(path_to_m.ToString());


    if (launch)
    {
      System.Diagnostics.Process p = new System.Diagnostics.Process();

      p.StartInfo.FileName = pathtoexe;
      p.StartInfo.WorkingDirectory = dir + "\\";
      p.StartInfo.Arguments = "/wait /nodisplay /nojvm /nosplash /nodesktop /r \"try, run('" + pathtofile + "\"'),catch,exit,end,exit\"";
      p.StartInfo.Verb = "runas";

      p.Start();
      p.WaitForExit();


    }
    //GH OUTPUT COMMENTS
    Print("MATLAB EXE : " + path_to_exe);
    Print("SCRIPT DIR : " + dir);
    Print("SCRIPT FILE : " + filename);
    Print("PROCESS EXIT");
# ---------- end c_script_10 ----------
panel_17 = Panel(c_script_10.out)  # disabled

medges_3 = MeshEdges(Mesh=mjoin)  # -> NakedEdges, InteriorEdges, NonManifoldEdges
item_6 = ListItem(List=mesh_3, Index=0, Wrap=True)  # disabled
swatch = ColourSwatch(SwatchColor=RGB(168, 224, 223))  # disabled
swatch_2 = ColourSwatch(SwatchColor=RGBA(221, 240, 53, 87))  # disabled
swatch_3 = ColourSwatch(SwatchColor=RGBA(0, 0, 0, 148))  # disabled
preview = CustomPreview(Geometry=item_6, Shader=swatch_2)  # disabled
preview_2 = CustomPreview(Geometry=mjoin, Shader=swatch_3)  # disabled
preview_3 = CustomPreview(
    Geometry=[medges.NakedEdges, medges_3.NakedEdges, medges_3.InteriorEdges],
    Shader=ColourSwatch(SwatchColor=RGBA(0, 0, 0, 41)))
preview_4 = CustomPreview(
    Geometry=mesh_3,
    Shader={ambient=RGB(0, 0, 0), diffuse=RGB(255, 105, 180), emission=RGB(76, 32, 54), shine=0.5, specular=RGB(255, 255, 255), transparency=0})  # disabled
preview_5 = CustomPreview(Geometry=mplane.Mesh, Shader=swatch)  # disabled

number_slider_11 = Slider(0, range=0..6)  # disabled
panel_18 = Panel(srf)  # disabled
item_7 = ListItem(List=srf, Index=0, Wrap=True)  # disabled

# ----
# Shade
# View
# Glare
wall_right = Mesh(c_script_2.mesh)
toggle = BooleanToggle(True)
wall_left = Mesh(c_script_4.mesh)
floor = Mesh(c_script.mesh)
back_wall = Mesh(c_script_3.mesh)
vec_2 = Vector(multiplication_5)
mesh_5 = Mesh(mplane.Mesh)
mesh_6 = Mesh(mesh_3)
vec_3 = Vector(multiplication_5)
vec_4 = Vector(facen.Normals)
shadeassess = ShadeAssessment(WindowPanelMesh=mesh_5, ShadeModuleMesh=mesh_6, ProjectionVector=vec_3, LaunchTheAnalysis=Toggle(True))  # -> MeshOfExposedWindowsSurface, AreaOfExposed, CommentOnOperationType
source = Mesh(shadeassess.MeshOfExposedWindowsSurface)
shadeassess_2 = ShadeAssessment(WindowPanelMesh=mesh_5, ShadeModuleMesh=mesh_6, ProjectionVector=vec_4, LaunchTheAnalysis=Toggle(True))  # -> MeshOfExposedWindowsSurface, AreaOfExposed, CommentOnOperationType
panel_19 = Panel(shadeassess.AreaOfExposed)
panel_20 = Panel(shadeassess_2.AreaOfExposed)
mesh_7 = Mesh(shadeassess.MeshOfExposedWindowsSurface)
mesh_8 = Mesh(shadeassess_2.MeshOfExposedWindowsSurface)

# ---- group: wall 1
glareassess = GlareOnWallPanel(WallPanel=wall_right, SourceOutline=source, ProjectionDirectionVector=vec_2, LaunchTheAnalysis=toggle)  # -> MeshOfGlareOnTheWallPanel, AreaOfGlareOnTheWallPanel, CommentOnOperationType, DebugMeshcutter

# ---- group: Wall 2
glareassess_2 = GlareOnWallPanel(WallPanel=wall_left, SourceOutline=source, ProjectionDirectionVector=vec_2, LaunchTheAnalysis=toggle)  # -> MeshOfGlareOnTheWallPanel, AreaOfGlareOnTheWallPanel, CommentOnOperationType, DebugMeshcutter

# ---- group: Floor
glareassess_3 = GlareOnWallPanel(WallPanel=floor, SourceOutline=source, ProjectionDirectionVector=vec_2, LaunchTheAnalysis=toggle)  # -> MeshOfGlareOnTheWallPanel, AreaOfGlareOnTheWallPanel, CommentOnOperationType, DebugMeshcutter

# ---- group: back wall
glareassess_4 = GlareOnWallPanel(WallPanel=back_wall, SourceOutline=source, ProjectionDirectionVector=vec_2, LaunchTheAnalysis=toggle)  # -> MeshOfGlareOnTheWallPanel, AreaOfGlareOnTheWallPanel, CommentOnOperationType, DebugMeshcutter

# ----
panel_21 = Panel(glareassess_4.CommentOnOperationType)
addition_3 = Addition(
    A=glareassess.AreaOfGlareOnTheWallPanel,
    B=glareassess_2.AreaOfGlareOnTheWallPanel,
    C=glareassess_3.AreaOfGlareOnTheWallPanel,
    D=glareassess_4.AreaOfGlareOnTheWallPanel)

panel_22 = Panel(mesh_7)
viewer = ParamViewer(glareassess.MeshOfGlareOnTheWallPanel)
item_8 = ListItem(List=viewer, Index=Slider(0, range=0..10), Wrap=True)
msplit = MeshSplit(Mesh=glareassess_2.DebugMeshcutter, Splitters=mesh_4)  # disabled
branch = TreeBranch(Tree=glareassess.MeshOfGlareOnTheWallPanel, Path=item_8, MaintainPaths=True)
branch_2 = TreeBranch(Tree=glareassess_2.MeshOfGlareOnTheWallPanel, Path=item_8, MaintainPaths=True)
branch_3 = TreeBranch(Tree=glareassess_3.MeshOfGlareOnTheWallPanel, Path=item_8, MaintainPaths=True)
branch_4 = TreeBranch(Tree=glareassess_4.MeshOfGlareOnTheWallPanel, Path=item_8, MaintainPaths=True)
mesh_9 = Mesh(glareassess_4.DebugMeshcutter)
list = ItemSelector(msplit, {"Mesh (V:7  F:5)": "Mesh (V:7 F:5)", "Mesh (V:9  F:5)": "Mesh (V:9 F:5)"}, selected="Mesh (V:9  F:5)")  # disabled
item_9 = ListItem(List=branch, Index=number_slider_8, Wrap=True)
item_10 = ListItem(List=branch_2, Index=number_slider_8, Wrap=True)
item_11 = ListItem(List=branch_3, Index=number_slider_8, Wrap=True)
item_12 = ListItem(List=branch_4, Index=number_slider_8, Wrap=True)
